# Dynamo graph Barrier.dyn (Dynamo 2.12.0.5650)

# group: Get all Elements from Lines category
categories = Categories("OST_Lines")
all_elements_of_category = ElementsOfCategory(Category=categories)

# group: Filter Barrier FL & Alignment
code_block = CodeBlock { "Line Style"; }
getParameterValueByName = Element.GetParameterValueByName(element=all_elements_of_category, parameterName=code_block)
code_block_2 = CodeBlock(x=getParameterValueByName) { x.Name; }
string = StringInput("GDOT_EDGE_OF_DECK_LEFT")
string_2 = StringInput("GDOT_EDGE_OF_DECK_RIGHT")
string_3 = StringInput("GDOT_Alignment_CL")
list_create = List.Create(item0=string, item1=string_2, item2=string_3)
allIndicesOf = List.AllIndicesOf(list=code_block_2, item=list_create)
getItemAtIndex = List.GetItemAtIndex(list=all_elements_of_category, index=allIndicesOf)

# group: Create Barriers & Alignment geometry
geometry = Element.Geometry(element=getItemAtIndex)
flatten = List.Flatten(list=geometry@@L3)
byJoinedCurves = PolyCurve.ByJoinedCurves(curves=flatten)
code_block_3 = CodeBlock(l1=byJoinedCurves) { Barriers = List.DropItems(l1,-1); Align = List.GetItemAtIndex(l1,2); }

# group: Get PierCap centrelines
family_types = FamilyTypes("GEN_BRDG_AXIS_Pier:Pier")
all_elements_of_family_type = ElementsOfFamilyType(Family_Type=family_types)
locations = AdaptiveComponent.Locations(adaptiveComponent=all_elements_of_family_type)
transpose = List.Transpose(lists=locations)
code_block_4 = CodeBlock(a=transpose) { a[0]; a[1]; }
byStartPointEndPoint = Line.ByStartPointEndPoint(startPoint=code_block_4.out0, endPoint=code_block_4.out1)

# group: Sort PierCap centrelines by Chainages
intersect = Geometry.Intersect(geometry=code_block_3.Align, other=byStartPointEndPoint)
flatten_2 = List.Flatten(list=intersect)
parameterAtPoint = Curve.ParameterAtPoint(curve=code_block_3.Align, point=flatten_2)
sortByKey = List.SortByKey(list=byStartPointEndPoint, keys=parameterAtPoint)

# group: Intersect PierCap centrelines with Barrier centrelines
intersect_2 = Geometry.Intersect(geometry=sortByKey.sortedList, other=code_block_3.Barriers@L1)
flatten_3 = List.Flatten(list=intersect_2@L3)
pruneDuplicates = Point.PruneDuplicates(points=flatten_3)
closestPointTo = Geometry.ClosestPointTo(geometry=code_block_3.Barriers, other=pruneDuplicates)

# group: Get parameters from point of intersection
parameterAtPoint_2 = Curve.ParameterAtPoint(curve=code_block_3.Barriers@L1, point=closestPointTo@L2)
segmentLengthAtParameter = Curve.SegmentLengthAtParameter(curve=code_block_3.Barriers@L1, parameter=parameterAtPoint_2@L2)

# group: List management
code_block_5 = CodeBlock { 0..1; 1; }
sublists = List.Sublists(list=segmentLengthAtParameter@@L2, ranges=code_block_5.out0, offset=code_block_5.out1)
code_block_6 = CodeBlock { -1; }
dropItems = List.DropItems(list=sublists@@L3, amount=code_block_6)
code_block_7 = CodeBlock { 0; 1; }
getItemAtIndex_2 = List.GetItemAtIndex(list=dropItems@@L2, index=code_block_7.out0)
getItemAtIndex_3 = List.GetItemAtIndex(list=dropItems@@L2, index=code_block_7.out1)

# group: Get coordinate systems from Barrier chainages
number = DoubleInput(10)
code_block_8 = CodeBlock(start=getItemAtIndex_2, end=getItemAtIndex_3, step=number) { start..end..~step; }
coordinateSystemAtSegmentLength = Curve.CoordinateSystemAtSegmentLength(curve=code_block_3.Barriers@L1, segmentLength=code_block_8@@L3)
origin = CoordinateSystem.Origin(coordinateSystem=coordinateSystemAtSegmentLength)

# group: Rotate left barrier profiles
XAxis = CoordinateSystem.XAxis(coordinateSystem=coordinateSystemAtSegmentLength)
XAxis_2 = Vector.XAxis()
ZAxis = Vector.ZAxis()
angleAboutAxis = Vector.AngleAboutAxis(vector=XAxis, otherVector=XAxis_2, rotationAxis=ZAxis)
python_script = Python(IN[0]=angleAboutAxis)  # IronPython2
# ---------- python_script.python (20 lines) ----------
rot = IN[0]
lst = []
for index, i in enumerate(rot):
  if index == 0:
    lstt = []
    for ii in i:
      lsttt = []
      for iii in ii:
        lsttt.append(iii+180)
      lstt.append(lsttt)
  else:
    lstt = []
    for ii in i:
      lsttt = []
      for iii in ii:
        lsttt.append(iii)
      lstt.append(lsttt)
  lst.append(lstt)	
			
OUT = lst
# ----------------------------------------

# group: Insert families & rotation
family_types_2 = FamilyTypes("ACM_PRF_BarrierSection:__BarrierSection")
byPoint = FamilyInstance.ByPoint(familyType=family_types_2, point=origin)
setRotation = FamilyInstance.SetRotation(familyInstance=byPoint, degree=python_script)

curves = Element.Curves(element=setRotation)
byJoinedCurves_2 = PolyCurve.ByJoinedCurves(curves=curves)
byLoft = Solid.ByLoft(crossSections=byJoinedCurves_2)
code_block_9 = CodeBlock { 1; }
getItemAtIndex_4 = List.GetItemAtIndex(list=byLoft@L2, index=code_block_9)
lastItem = List.LastItem()  # unwired: list
